# Grasshopper definition 200820_SampleFile_KukaVarProxy.gh (Grasshopper 1.0.7)
# plug-ins: Simulacrum, Virtual Robot

# ---- group: TCP Camera
pln = Plane(Plane(origin=(2.000640869, 531.9445496, 38.05518532), x=(-1, 0, 0), y=(0, 0, -1)))

# ---- group: TCP Vacuum
pln_2 = Plane(Plane(origin=(-61.32697678, 42.58398437, 203.5121765), x=(-1, 0, 0), y=(0, 1, 0)))

# ---- group: TCP Pneumatic
pln_3 = Plane(Plane(origin=(4.3279953, 614.2059937, -20.049), x=(-0.9999182857, 0.01278365864, 0), y=(0, 0, -1)))

# ----
# PINP Tool
list = ValueList({"Vacuum - Gripper": 0, "Pneumatic - Gripper": 1, "Camera - Gripper": 2}, selected="Camera - Gripper")
list_2 = ValueList({"Manual Tool Selection": 0, "Automatic Tool Selection": 1}, selected="Automatic Tool Selection")
# PINP SIMULATION
gripper_open = BooleanToggle(False)
gframe = GetFrame(Frame=pln_2)  # -> XYZLocation, ABCOrientation
gframe_2 = GetFrame(Frame=pln_3)  # -> XYZLocation, ABCOrientation
tool2_pneumatic_gripper = Panel([gframe_2.XYZLocation, gframe_2.ABCOrientation])
tool1_vacuum_gripper = Panel([gframe.XYZLocation, gframe.ABCOrientation])
cluster = Cluster_6(G=gripper_open)
filter = StreamFilter(Gate=list, Stream0=pln_2, Stream1=pln_3, Stream2=pln)
cluster_2 = Cluster_3()
end_effector = DefineEndEffector(Geometry=cluster, TCPFrame=filter, MountingFrame=cluster_2)

# ---- group: Check Plane Orientation
Z = UnitZ(Factor=1)
deplane = DeconstructPlane(Plane=pln)  # -> Origin, XAxis, YAxis, ZAxis
line = LineSDL(Start=deplane.Origin, Direction=deplane.ZAxis, Length=Slider(1000, range=0..1000))

# ----
pln_4 = Plane(Plane(origin=(0, 2057.21862, 0), x=(0.70375053, -0.7104461987, 0.001179093362), y=(0.7104383546, 0.7037490925, 0.003815651494)))

# ---- group: MANUAL TCP_PINP
crv = Curve(<curve referenced from the Rhino model>)
crv_2 = Curve(<curve referenced from the Rhino model>)
crv_3 = Curve(<curve referenced from the Rhino model>)
cluster_3 = Cluster_4(C_3=crv, C_2=crv_2, C=crv_3)

# ---- group: ROBROOT PINP
pln_5 = Plane(pln_4)

# ----
sframe = SetFrame(XYZLocation="{186.181030,-1164.40527,2909.37695}", ABCOrientation="{-171.194748,1.20841098,163.165756}")

# ---- group: KR500
cluster_4 = Cluster_5(robroot=pln_5, end_effector=end_effector)  # disabled

# ---- group: MANUAL_TCP_PINP
pln_6 = Plane(cluster_3)

# ----
pln_7 = Plane(sframe)
orient = Orient(Geometry=pln_7, Source=PlaneXY(0, 0, 0), Target=pln_5)  # -> Geometry, Transform
gframe_3 = GetFrame(Frame=pln)  # -> XYZLocation, ABCOrientation
axis_toggles = Data([Toggle(False), Toggle(False), Toggle(False)])

# ---- group: Home_Assembly (Tool 2)
pln_8 = Plane(orient.Geometry)

# ----
tool8_camera = Panel([gframe_3.XYZLocation, gframe_3.ABCOrientation])
colormap_kr500 = Panel("""50,50,50
50,50,50
200,200,200
50,50,50
50,50,50
50,50,50
50,50,50
50,50,50
50,50,50
200,200,200
50,50,50
50,50,50
50,50,50
200,200,200
50,50,50
200,200,200
200,200,200
200,200,200
200,200,200
50,50,50
50,50,50
50,50,50
50,50,50
50,50,50
50,50,50
50,50,50
50,50,50
50,50,50""")
col = Colour(colormap_kr500)

# ---- group: KR500 MeshMap
cluster_5 = Cluster_2()

# ----
point = Point(<point referenced from the Rhino model>)
predefined_kuka_kr_500_3_robot = PredefinedKUKAKR5003Robot(RobRootFrame=pln_5, EndEffectorOptional=end_effector)
robot_ik = RobotInverseKinematics(Robot=predefined_kuka_kr_500_3_robot, AxisToggles=axis_toggles, useColorPreview=True)  # -> PoseGeometry, AxisValues; disabled
item = ListItem(List=robot_ik.PoseGeometry, Index=Slider(28, range=0..30), Wrap=True)
preview = CustomPreview(Geometry=robot_ik.PoseGeometry, Shader=col)

# ----
# Show Limit Exceeding Axis
kr420_axis_limits = KR420AxisLimits()
cluster_6 = Cluster(L=robot_ik.PoseGeometry, V=robot_ik.AxisValues, D=kr420_axis_limits, T=cluster_5)  # -> i_2, i

yz_plane = YZPlane(Origin=point)
plane = Plane(point)
xy_plane = XYPlane(Origin=point)
pi = Pi(Factor=Slider(0.86, range=0..10))
flip_plane = FlipPlane(Plane=yz_plane, ReverseX=False, ReverseY=False, SwapAxes=True)

preview_2 = CustomPreview(Geometry=cluster_6.i_2, Shader=ColourSwatch(SwatchColor=RGB(255, 0, 0)))

rotate = Rotate(Geometry=xy_plane, Angle=pi, Plane=PlaneXY(0, 0, 0))  # -> Geometry, Transform
rotate_plane = RotatePlane(Plane=xy_plane, Angle=pi)
robot_inverse_kinematics = RobotInverseKinematics(
    Robot=predefined_kuka_kr_500_3_robot,
    TargetTCPFrame=rotate_plane,
    AxisToggles=[False, False, False],
    useColorPreview=True)  # -> PoseGeometry, AxisValues
robot_forward_kinematics = RobotForwardKinematics(Robot=predefined_kuka_kr_500_3_robot, AxisValues=[0, -90, 90, 0, 0, 0], useColorPreview=True)  # -> PoseGeometry, TCPFrame
robot_forward_kinematics_2 = RobotForwardKinematics(Robot=predefined_kuka_kr_500_3_robot, AxisValues=robot_inverse_kinematics.AxisValues, useColorPreview=True)  # -> PoseGeometry, TCPFrame; disabled
panel = Panel(robot_inverse_kinematics.AxisValues)
custom_preview = CustomPreview(
    Geometry=robot_inverse_kinematics.PoseGeometry,
    Material={diffuse=RGB(221, 160, 221), emission=RGB(66, 48, 66), shine=0.5, specular=RGB(255, 255, 255), transparency=0})
get_frame = GetFrame(Frame=robot_forward_kinematics.TCPFrame)  # -> XYZLocation, ABCOrientation
get_frame_2 = GetFrame(Frame=robot_forward_kinematics.TCPFrame)  # -> XYZLocation, ABCOrientation
deconstruct = Deconstruct(Point=get_frame.XYZLocation)  # -> XComponent, YComponent, ZComponent
deconstruct_vector = DeconstructVector(Vector=get_frame.ABCOrientation)  # -> XComponent, YComponent, ZComponent
ghpython_script = GhPythonScript(
    x=deconstruct.XComponent,
    y=deconstruct.YComponent,
    z=deconstruct.ZComponent,
    A=deconstruct_vector.XComponent,
    B=deconstruct_vector.YComponent,
    C=deconstruct_vector.ZComponent)  # -> out, a
# ---------- ghpython_script: Python ----------
f = " "
f = "{POS: X " , x , ", Y " , y , ", Z " , z , ", A " , A , ", B " , B , ", C " , C , "}"
a = f
# ---------- end ghpython_script ----------
text_join = TextJoin(Text=ghpython_script.a)
client = TCPClient(ServerIP="192.168.2.2", ServerPort="7000", ConnectionTrigger=Toggle(False))
panel_2 = Panel(text_join)

# ---- group: Write Values
panel_3 = Panel("""0.0
-90
120
0.0
0.0
0.0""")
button = Button()
custom_write = KRCWrite(Socket=client, Write="MyPosSimon", Input=panel_2, Run=Toggle(True), RefreshRate=20)
write_position = WritePosition(Socket=client, Write="MyPosSimon", AxisValues=robot_inverse_kinematics.AxisValues, Run=Toggle(False), RefreshRate=100)
panel_4 = Panel(custom_write)
panel_5 = Panel(write_position)

# ----
panel_6 = Panel("False")

# ---- group: Read Values
custom_read = KRCRead(Socket=client, VarRead="MyPosSimon", ReadTrigger=Toggle(False), RefreshRate=20)
read_position = ReadActPos(Socket=client, Run=Toggle(True), RefreshRate="30")  # -> AxisValues, TCPPlane, XYZ, ABC, E6POS, E6AXIS
custom_read_2 = KRCRead(Socket=client, VarRead="SimonBool", ReadTrigger=Toggle(False), RefreshRate=20)
read_base = ReadBase(Socket=client, Run=Button())  # -> BASE, BASEPlane, TOOL, TOOLPlane
panel_7 = Panel(custom_read)
panel_8 = Panel(custom_read_2)
panel_9 = Panel(read_base.BASE)
panel_10 = Panel(read_position.AxisValues)
pln_9 = Plane(read_base.BASEPlane)
pln_10 = Plane(read_base.TOOLPlane)
pln_11 = Plane(read_position.TCPPlane)
panel_11 = Panel(read_base.TOOL)

# ----
list_item = ListItem(List=read_base.TOOL, Index=0, Wrap=True)  # -> Item, Item1, Item2
list_item_2 = ListItem(List=read_base.TOOL, Index=0, Wrap=True)  # -> Item, Item1, Item2, Item3, Item4, Item5
construct_point = ConstructPoint(XCoordinate=list_item.Item, YCoordinate=list_item.Item1, ZCoordinate=list_item.Item2)
construct_point_2 = ConstructPoint(XCoordinate=list_item_2.Item3, YCoordinate=list_item_2.Item4, ZCoordinate=list_item_2.Item5)
monitor = NetstatMonitor(Socket=client)
predefined_kuka_kr_500_3_robot_2 = PredefinedKUKAKR5003Robot(RobRootFrame=pln_5, EndEffectorOptional=end_effector)

# ---- group: Check Connection
panel_12 = Panel(monitor)

# ----
kuka_kr_125_2 = PredefinedKUKAKR1252(RobRootFrame=read_base.BASEPlane)

# ---- group: Robot Sim
robot_fk = RobotForwardKinematics(Robot=predefined_kuka_kr_500_3_robot_2, AxisValues=read_position.AxisValues, useColorPreview=True)  # -> PoseGeometry, TCPFrame
pln_12 = Plane(robot_fk.TCPFrame)

# ---- group: Kuka Datatype Converter
converter = Converter(E6POS=read_position.E6POS, E6AXIS=panel_7)  # -> E6POSNames, E6POSValues, E6AXISNames, E6AXISValues, FRAMENames, FRAMEValues
panel_13 = Panel(converter.E6POSValues)
panel_14 = Panel(converter.E6POSNames)

# ----
set_frame = SetFrame(XYZLocation=Point(0, 0, 0), ABCOrientation=Vector(0, 0, 0))
list_item_3 = ListItem(List=converter.E6AXISValues, Index=0, Wrap=True)  # -> Item, Item1, Item2, Item3, Item4, Item5
merge = Merge(
    Data1=list_item_3.Item,
    Data2=list_item_3.Item1,
    Data3=list_item_3.Item2,
    Data4=list_item_3.Item3,
    Data5=list_item_3.Item4,
    Data6=list_item_3.Item5)
panel_15 = Panel(get_frame_2.XYZLocation)
panel_16 = Panel(get_frame_2.ABCOrientation)

# ----
# PINP TCP
list_3 = ValueList({"Manual TCP Control": 0, "Automatic TCP": 1}, selected="Automatic TCP")
pt = Point(Point(1287.14972, 2586.869779, 1286.50553))

# ---- group: PinP TCP Simulation
pln_13 = Plane(pt)

# ----
filter_2 = StreamFilter(Gate=list_3, Stream0=pln_6, Stream1=pln_13)  # -> simplify(Stream)

coord_display = CoordinateFrameDisplay(
    CoordinateFrame=flatten(filter_2),
    ArrowLengths=[120, 120, 120],
    ArrowWidths=2,
    ArrowColors=[RGB(139, 0, 0), RGB(0, 100, 0), RGB(0, 0, 139)])

# ==== cluster KR420AxisLimits
dom = ConstructDomain(DomainStart=Slider(-350, range=-360..360), DomainEnd=Slider(350, range=-360..360))
dom_2 = ConstructDomain(DomainStart=Slider(-120, range=-360..360), DomainEnd=Slider(120, range=-360..360))
dom_3 = ConstructDomain(DomainStart=Slider(-100, range=-360..360), DomainEnd=Slider(144, range=-360..360))
dom_4 = ConstructDomain(DomainStart=Slider(-350, range=-360..360), DomainEnd=Slider(350, range=-360..360))
dom_5 = ConstructDomain(DomainStart=Slider(-185, range=-360..360), DomainEnd=Slider(185, range=-360..360))
dom_6 = ConstructDomain(DomainStart=Slider(-130, range=-360..360), DomainEnd=Slider(20, range=-360..360))
merge = Merge(Data1=dom_5, Data2=dom_6, Data3=dom_3, Data4=dom, Data5=dom_2, Data6=dom_4)
R = ClusterOutput(merge)

# ==== cluster Cluster
V = ClusterInput()
D = ClusterInput()
T = ClusterInput()
inc = Includes(Value=V, Domain=D)  # -> Includes, Deviation
ma = MassAddition(Input=inc.Deviation)  # -> Result, PartialResults
python = PythonScript(x=inc.Deviation)  # -> out, graft(a), graft(b); inputs x: list
# ---------- python: Python ----------
error_axis_list = []
ok_axis_list = []

for i in range(0,len(x)):
    if x[i] != 0:
        error_axis_list.append(i)
    else:
        ok_axis_list.append(i)

a = error_axis_list
b = ok_axis_list
# ---------- end python ----------
equals = Equality(FirstNumber=ma.Result, SecondNumber=0)  # -> Equality, Inequality
panel = Panel(equals.Equality)
path = ConstructPath(Indices=python.a)
path_2 = ConstructPath(Indices=python.b)
branch = TreeBranch(Tree=T, Path=path, MaintainPaths=True)
branch_2 = TreeBranch(Tree=T, Path=path_2, MaintainPaths=True)
panel_2 = Panel(branch_2)
L = ClusterInput()
item = ListItem(List=L, Index=branch_2, Wrap=True)
item_2 = ListItem(List=L, Index=branch, Wrap=True)
i = ClusterOutput(item)
i_2 = ClusterOutput(item_2)

# ==== cluster Cluster_2
panel = Panel("""0
2""")
panel_2 = Panel("""2
9""")
panel_3 = Panel("""9
13""")
panel_4 = Panel("""13
15""")
panel_5 = Panel("""15
16""")
panel_6 = Panel("""16
17""")
entwine = Entwine(
    Branch00=panel,
    Branch01=panel_2,
    Branch02=panel_3,
    Branch03=panel_4,
    Branch04=panel_5,
    Branch05=panel_6,
    FlattenInputs=True)  # -> simplify(Result)
R = ClusterOutput(entwine)

# ==== cluster Cluster_3
pt = Point(<point referenced from the Rhino model>)
xy = XYPlane(Origin="{0,0,0}")
deplane = DeconstructPlane(Plane=xy)  # -> Origin, XAxis, YAxis, ZAxis
pl = ConstructPlane(Origin=deplane.Origin, XAxis=deplane.XAxis, YAxis=deplane.YAxis)
P = ClusterOutput(xy)

# ==== cluster Cluster_4
C = ClusterInput()
C_2 = ClusterInput()
C_3 = ClusterInput()
end = EndPoints(Curve=C)  # -> Start, End
end_2 = EndPoints(Curve=C_2)  # -> Start, End
end_3 = EndPoints(Curve=C_3)  # -> Start, End
vec2pt = Vector2Pt(PointA=end.Start, PointB=end.End, Unitize=False)  # -> Vector, Length
vec2pt_2 = Vector2Pt(PointA=end_2.Start, PointB=end_2.End, Unitize=False)  # -> Vector, Length
vec2pt_3 = Vector2Pt(PointA=end_3.Start, PointB=end_3.End, Unitize=False)  # -> Vector, Length
pl = ConstructPlane(Origin=end_3.Start, XAxis=vec2pt_3.Vector, YAxis=vec2pt_2.Vector)
pl_2 = ClusterOutput(pl)

# ==== cluster Cluster_5
end_effector = ClusterInput()
pt = ConstructPoint(XCoordinate="0", YCoordinate=0, ZCoordinate="0")
pt_2 = ConstructPoint(XCoordinate="500", YCoordinate=0, ZCoordinate="1045")
pt_3 = ConstructPoint(XCoordinate="500", YCoordinate=0, ZCoordinate="2345")
pt_4 = ConstructPoint(XCoordinate="1210", YCoordinate=0, ZCoordinate="2290")
pt_5 = ConstructPoint(XCoordinate="1525", YCoordinate=0, ZCoordinate="2290")
pt_6 = ConstructPoint(XCoordinate="1815", YCoordinate=0, ZCoordinate="2290")
robroot = ClusterInput()
mesh = Mesh(<mesh referenced from the Rhino model>)
mesh_2 = Mesh([<mesh referenced from the Rhino model> x5])
mesh_3 = Mesh(<mesh referenced from the Rhino model>)
mesh_4 = Mesh(<mesh referenced from the Rhino model>)
mesh_5 = Mesh(<mesh referenced from the Rhino model>)
mesh_6 = Mesh([<mesh referenced from the Rhino model> x8])
mesh_7 = Mesh(<mesh referenced from the Rhino model>)
kuka_robot = Define6AxisKUKARobot(
    Axis1PivotPoint=pt,
    Axis2PivotPoint=pt_2,
    Axis3PivotPoint=pt_3,
    Axis4PivotPoint=pt_4,
    Axis5PivotPoint=pt_5,
    Axis6PivotPoint=pt_6,
    BaseGeometry=mesh,
    Axis1Geometry=mesh_6,
    Axis2Geometry=mesh_7,
    Axis3Geometry=mesh_2,
    Axis4Geometry=mesh_3,
    Axis5Geometry=mesh_4,
    Axis6Geometry=mesh_5,
    RobRootFrame=robroot,
    EndEffector=end_effector)
robot = ClusterOutput(kuka_robot)

# ==== cluster Cluster_6
geo = Geometry([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])
geo_2 = Geometry([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])
mjoin = MeshJoin(Meshes=geo)
mjoin_2 = MeshJoin(Meshes=geo_2)
clean = CleanTree(RemoveNulls=True, RemoveInvalid=True, RemoveEmpty=False, Tree=mjoin_2)
clean_2 = CleanTree(RemoveNulls=True, RemoveInvalid=True, RemoveEmpty=False, Tree=mjoin)
G = ClusterInput()
filter = StreamFilter(Gate=G, Stream0=clean, Stream1=clean_2)
s_0 = ClusterOutput(filter)
