# Grasshopper definition 20200204_KukaVarProxy_KukaFollowsLine.gh (Grasshopper 1.0.7)
# plug-ins: Pufferfish, Kangaroo2 Components, Simulacrum, Virtual Robot

number_slider = Slider(0, range=0..20)
num = Number(9.485164035)
Z = UnitZ(Factor=num)
pt = Point(Point(1565.070568, 1105.439095, 52))
move = Move(Geometry=pt, Motion=Z)  # -> Geometry, Transform
max_bridge_width = Slider(375, range=0..1000)
min_bridge_width = Slider(200, range=0..1000)
Y = UnitY(Factor=Slider(2500, range=0..10000))
pdecon = Deconstruct(Point=move.Geometry)  # -> XComponent, YComponent, ZComponent
neg = Negative(Value=Y)
ply_thickness = Slider(9, range=0..100)
move_2 = Move(Geometry=move.Geometry, Motion=neg)  # -> Geometry, Transform
cat = Catenary(PointA=move.Geometry, PointB=move_2.Geometry, Length=Slider(2650, range=0..10000), Gravity=expr("-x", Vector(0, 0, -1)))
curvepoint = PointOnCurve(cat, parameter=0.5)
pdecon_2 = Deconstruct(Point=curvepoint)  # -> XComponent, YComponent, ZComponent
pt_2 = ConstructPoint(XCoordinate=pdecon_2.XComponent, YCoordinate=pdecon_2.YComponent, ZCoordinate=pdecon.ZComponent)
subtraction = Subtraction(A=pdecon_2.ZComponent, B=pdecon.ZComponent)
ln = Line(StartPoint=curvepoint, EndPoint=pt_2)
panel = Panel(subtraction)
division = Division(A=max_bridge_width, B=2)
linedim = LineDimension(Line=ln, Text="{0:0.00}", Size=Slider(46, range=0..100))
X = UnitX(Factor=division)
divide = DivideCurve(Curve=cat, Count=Slider(7, range=0..10), Kinks=False)  # -> Points, Tangents, Parameters
cull_i = CullIndex(List=divide.Points, Indices=-1, Wrap=True)
neg_2 = Negative(Value=X)
pline = PolyLine(Vertices=divide.Points, Closed=False)
cull_i_2 = CullIndex(List=divide.Points, Indices=0, Wrap=True)
division_2 = Division(A=min_bridge_width, B=2)
Y_2 = UnitY(Factor=1)

# ----
# Test1_KukaFollowsLine
# KukaVarProxy
panel_2 = Panel("141.58.154.149")
client = TCPClient(ServerIP=panel_2, ServerPort="7000", ConnectionTrigger=Toggle(False))
monitor = NetstatMonitor(Socket=client)

merge = Merge(Data1=X, Data2=neg_2)
vec2pt = Vector2Pt(PointA=cull_i, PointB=cull_i_2, Unitize=False)  # -> Vector, Length
X_2 = UnitX(Factor=division_2)
pipe = Pipe(Curve=pline, Radius=Slider(35, range=0..100), Caps=0)
move_3 = Move(Geometry=pline, Motion=merge)  # -> Geometry, Transform
angle = Angle(VectorA=vec2pt.Vector, VectorB=Y_2)  # -> Angle, Reflex
shift = ShiftList(List=vec2pt.Vector, Shift=1, Wrap=True)
neg_3 = Negative(Value=X_2)

# ---- group: Check Connection
panel_3 = Panel(monitor)

# ----
curvepoint_2 = PointOnCurve(cat, parameter=0.5)
deg = Degrees(Radians=angle.Angle)
merge_2 = Merge(Data1=X_2, Data2=neg_3)
split = SplitList(List=angle.Angle, Index=3)  # -> ListA, ListB
angle_2 = Angle(VectorA=vec2pt.Vector, VectorB=shift)  # -> Angle, Reflex
explode = Explode(Curve=graft(move_3.Geometry), Recursive=True)  # -> Segments, Vertices
neg_4 = Negative(Value=split.ListB)
deg_2 = Degrees(Radians=angle_2.Angle)
number_slider_2 = Slider(200, range=0..1000)
flip = FlipMatrix(Data=explode.Segments)
move_4 = Move(Geometry=curvepoint_2, Motion=merge_2)  # -> Geometry, Transform
end = EndPoints(Curve=move_3.Geometry)  # -> Start, End
merge_3 = Merge(Data1=split.ListA, Data2=neg_4)
cull_i_3 = CullIndex(List=divide.Points, Indices=[0, -1], Wrap=True)
round = Round(Number=deg_2)  # -> Nearest, Floor, Ceiling
number_slider_3 = Slider(150, range=0..1000)
panel_4 = Panel(deg)
loft = Loft(Curves=flip, Options={Adjust=False, Closed=False, LoftEnds=0, LoftSimp=0, LoftType=0, Rebuild=10, Refit=0.01})
merge_4 = Merge(Data1=simplify(graft(end.Start)), Data2=simplify(graft(move_4.Geometry)), Data3=simplify(graft(end.End)))  # -> simplify(Result)
cull_i_4 = CullIndex(List=round.Nearest, Indices=-1, Wrap=True)
xy = XYPlane(Origin=move.Geometry)
yz = YZPlane(Origin=cull_i_3)
concat = Concatenate(FragmentA=cull_i_4, FragmentB="°")
dom = ConstructDomain(DomainStart=expr("x/2", number_slider_2), DomainEnd=expr("-x/2", number_slider_2))
project = Project(Geometry=merge_4, Plane=xy)  # -> Geometry, Transform
pt_3 = Point(Point(0, 0, 0))

# ---- group: Kuka Datatype Converter
converter = Converter()  # -> E6POSNames, E6POSValues, E6AXISNames, E6AXISValues, FRAMENames, FRAMEValues
panel_5 = Panel(converter.E6POSNames)
panel_6 = Panel(converter.E6POSValues)

# ---- group: Read Values
read_position = ReadActPos(Socket=client, Run=Toggle(True), RefreshRate="500")  # -> AxisValues, TCPPlane, XYZ, ABC, E6POS, E6AXIS
read_base = ReadBase(Socket=client, Run=Button())  # -> BASE, BASEPlane, TOOL, TOOLPlane
panel_7 = Panel(read_position.AxisValues)
pln = Plane(read_base.TOOLPlane)
pln_2 = Plane(read_base.BASEPlane)
panel_8 = Panel(read_base.TOOL)
panel_9 = Panel(read_base.BASE)
pln_3 = Plane(read_position.TCPPlane)

# ----
X_3 = UnitX(Factor=expr("x/2", number_slider_2))
intcrv = Interpolate(Vertices=project.Geometry, Degree=3, Periodic=False, KnotStyle=1)  # -> Curve, Length, Domain
Z_2 = UnitZ(Factor=Slider(6000, range=0..10000))
tag = TextTag3D(Location=yz, Text=concat, Size=50, Justification=7)
extr = Extrude(Base=intcrv.Curve, Direction=Z_2)
X_4 = UnitX(Factor=number_slider_3)
item = ListItem(List=flatten(extr), Index=0, Wrap=True)  # -> Item, Item1
split_2 = SplitBrep(Brep=simplify(loft), Cutter=item.Item)
move_5 = Move(Geometry=pt_3, Motion=X_4)  # -> Geometry, Transform
item_2 = ListItem(List=split_2, Index=0, Wrap=True)
ln_2 = Line(StartPoint=pt_3, EndPoint=move_5.Geometry)
item_3 = ListItem(List=deg, Index=0, Wrap=True)
split_3 = SplitBrep(Brep=simplify(item_2), Cutter=item.Item1)
rectangle = Rectangle(Plane=pt_3, XSize=dom, YSize=Slider(20, range=0..100), Radius=0)  # -> Rectangle, Length

# ---- group: Show Current Position Of Robot
kuka_kr_125_2 = PredefinedKUKAKR1252(RobRootFrame=PlaneXY(0, 0, 0))
robot_fk = RobotForwardKinematics(Robot=kuka_kr_125_2, AxisValues=panel_7, useColorPreview=True)  # -> PoseGeometry, TCPFrame
pln_4 = Plane(robot_fk.TCPFrame)

# ----
rotate = Rotate(Geometry=ln_2, Angle=degrees(item_3), Plane=PlaneXY(0, 0, 0))  # -> Geometry, Transform
end_2 = EndPoints(Curve=rotate.Geometry)  # -> Start, End
explode_2 = Explode(Curve=rectangle.Rectangle, Recursive=True)  # -> Segments, Vertices
item_4 = ListItem(List=split_3, Index=1, Wrap=True)
offsrf = OffsetSurface(Surface=item_4, Distance=expr("-x", ply_thickness), BothSides=False, CreateSolid=True)
explode_3 = Explode(Curve=pline, Recursive=True)  # -> Segments, Vertices
number_slider_4 = Slider(0, range=0..10)
end_3 = EndPoints(Curve=explode_3.Segments)  # -> Start, End
vec2pt_2 = Vector2Pt(PointA=end_2.Start, PointB=end_2.End, Unitize=False)  # -> Vector, Length
wires = BrepWireframe(Brep=item_4, Density=-1)
brep = Brep(offsrf)
panel_10 = Panel(read_position.E6POS)
end_4 = EndPoints(Curve=rotate.Geometry)  # -> Start, End
move_6 = Move(Geometry=pt_3, Motion=X_3)  # -> Geometry, Transform
dim = Dimensions(Surface=item_4)  # -> flatten(UDimension), flatten(VDimension)
X_5 = UnitX(Factor=1)
pt_4 = Point(end_3.Start)
offset = OffsetCurve(Curve=rotate.Geometry, Distance=expr("-x", ply_thickness), Plane=PlaneXY(0, 0, 0), Corners=1)
curvepoint_3 = PointOnCurve(wires, parameter=0.5)
item_5 = ListItem(List=explode_2.Vertices, Index=3, Wrap=True)
unit = UnitVector(Vector=vec2pt_2.Vector)
amp = Amplitude(Vector=unit, Amplitude=Slider(20, range=0..100))
division_3 = Division(A=Slider(50, range=0..100), B=number_slider_3)
lng = ListLength(List=pt_4)
move_7 = Move(Geometry=rotate.Geometry, Motion=amp)  # -> Geometry, Transform
merge_5 = Merge(Data1=end_4.Start, Data2=end_4.End, Data3=move_6.Geometry)  # -> flatten(Result)
panel_11 = Panel(dim.UDimension)
panel_12 = Panel(dim.VDimension)
pdecon_3 = Deconstruct(Point=curvepoint_3)  # -> XComponent, YComponent, ZComponent
hframe = HorizontalFrame(Curve=reparameterize(move_7.Geometry), Parameter=division_3)
series = Series(Start=0, Step=Slider(400, range=0..1000), Count=lng)
end_5 = EndPoints(Curve=move_7.Geometry)  # -> Start, End
move_8 = Move(Geometry=pt_3, Motion=expr("-x", X_3))  # -> Geometry, Transform
end_6 = EndPoints(Curve=offset)  # -> Start, End
pline_2 = PolyLine(Vertices=merge_5, Closed=True)
X_6 = UnitX(Factor=series)
sort = SortList(Keys=pdecon_3.XComponent, ValuesA=wires)  # -> Keys, ValuesA
number_slider_5 = Slider(100, range=0..100)
ln_3 = Line(StartPoint=end_5.Start, EndPoint=hframe)
offcrv = OffsetCurve(Curve=move_7.Geometry, Distance=expr("-x", ply_thickness), Plane=PlaneXY(0, 0, 0), BothSides=False, Kinks=0, CapType=1)

# ---- group: Painting Robot
swatch = ColourSwatch(SwatchColor=RGB(122, 122, 122))
swatch_2 = ColourSwatch(SwatchColor=RGB(8, 8, 8))
color_robot = ColorRobot(
    L=robot_fk.PoseGeometry,
    kd_2=ColourSwatch(SwatchColor=RGB(222, 227, 220)),
    ks_2=swatch_2,
    ke_2=swatch_2,
    kd=ColourSwatch(SwatchColor=RGB(219, 219, 219)),
    ks=swatch,
    ke=swatch)

# ----
number_slider_6 = Slider(5, range=0..100)
item_6 = ListItem(List=sort.ValuesA, Index=-1, Wrap=True)  # -> simplify(Item)
item_7 = ListItem(List=sort.ValuesA, Index=0, Wrap=True)
merge_6 = Merge(Data1=end_6.End, Data2=item_5, Data3=end_6.Start, Data4=move_8.Geometry)  # -> flatten(Result)
item_8 = ListItem(List=sort.ValuesA, Index=[1, 2], Wrap=True)
offcrv_2 = OffsetCurve(Curve=ln_3, Distance=expr("-x", ply_thickness), Plane=PlaneXY(0, 0, 0), BothSides=False, Kinks=0, CapType=1)
len = Length(Curve=item_6)
dupln = RemoveDuplicateLines(Lines=item_8, Tolerance=0.01)  # -> simplify(UniqueLines)
subtraction_2 = Subtraction(A=len, B=number_slider_5)
pline_3 = PolyLine(Vertices=merge_6, Closed=True)
explode_4 = Explode(Curve=pline_2, Recursive=True)  # -> Segments, Vertices
pt_5 = Point(end_5.Start)
frame = CurveFrame(Curve=item_6, Parameter=number_slider_5)
frame_2 = CurveFrame(Curve=item_6, Parameter=subtraction_2)
explode_5 = Explode(Curve=pline_3, Recursive=True)  # -> Segments, Vertices
pdecon_4 = Deconstruct(Point=pt_5)  # -> XComponent, YComponent, ZComponent
cull_i_5 = CullIndex(List=flatten(frame), Indices=-1, Wrap=True)
explode_6 = Explode(Curve=pline, Recursive=True)  # -> Segments, Vertices
item_9 = ListItem(List=explode_4.Segments, Index=0, Wrap=True)  # -> Item, Item1, Item2
item_10 = ListItem(List=explode_5.Segments, Index=0, Wrap=True)  # -> Item, Item1, Item2, Item3
equals = Equality(FirstNumber=deg, SecondNumber=0)  # -> Equality, Inequality
cull_i_6 = CullIndex(List=flatten(frame_2), Indices=0, Wrap=True)
pframe = PerpFrame(Curve=reparameterize(explode_6.Segments), Parameter=Slider(0.5, range=0..1))
join = JoinCurves(Curves=[item_10.Item1, item_10.Item2], Preserve=False)
join_2 = JoinCurves(Curves=[item_9.Item1, item_9.Item2], Preserve=False)
panel_13 = Panel(pdecon_4.YComponent)
dispatch = Dispatch(List=pframe, DispatchPattern=equals.Equality)  # -> ListA, ListB

# ---- group: KUKA TEST
# KUKATEST:
# Kuka Follows a segemented Line with small intervals.
# 
# See if it goes well by comparing the actual position of the kuka, with the point on the line.
# SET THE CORRESPONDING KUKAVARPROXY COMPONENTS TO TRUE! (Kuka_MoveCOunter/ Kuka_NextReceived)
# 
# The logic:
# 1. Write point to kuka.
# 2. Kuka Moves to point using LIN (with C_VEL)
# 2. Kuka increases MoveCounter counter by one.
# 3. Kuka sets NextReceived to False as soon as it finished a motion to the next point.
# 4. Manager in Grasshopper reads NextReceived as false.
# 5. Manager writes new point to the robot. (Using the MoveCounter from the kuka)
# 5. It sets NextReceieved to True.
# 6.Kuka goes to next point.
toggle = BooleanToggle(False)
custom_read = KRCRead(Socket=client, VarRead="NextReceived", ReadTrigger=toggle, RefreshRate="10")
custom_read_2 = KRCRead(Socket=client, VarRead="MoveCounter", ReadTrigger=Toggle(False), RefreshRate="10")
panel_14 = Panel(custom_read_2)
panel_15 = Panel(custom_read)
null_item = NullItem(Item=custom_read)  # -> NullFlags, InvalidFlags, Description
c_script = CSharpScript(Kuka_MoveCounter=custom_read_2, Kuka_NextReceived=custom_read, isNull=null_item.NullFlags)  # -> out, NextPointIndex, ReceivedNextPoint, Go; inputs Kuka_MoveCounter: Int32, Kuka_NextReceived: Boolean, isNull: Boolean
# ---------- c_script: C# ----------
    bool iGo = false;
    bool iReceivedNextPoint = true;
    
    if(Kuka_NextReceived == false && isNull == false){
      NextPointIndex = Kuka_MoveCounter;
      iGo = true;
    }
    else{
      iGo = false; 
    }

    Go = iGo;
    ReceivedNextPoint = iReceivedNextPoint;
# ---------- end c_script ----------
kuka_kr_125_2_2 = PredefinedKUKAKR1252(RobRootFrame=PlaneXY(0, 0, 0))

# ---- group: STOP KUKA MOVING
custom_write = KRCWrite(Socket=client, Write="KukaMove", Input="False", Run=Button(), RefreshRate=20)
panel_16 = Panel(custom_write)

# ----
fillet = Fillet(Curve=join_2, Radius=number_slider_6)
fillet_2 = Fillet(Curve=join, Radius=number_slider_6)
rotate_2 = Rotate(Geometry=dispatch.ListA, Angle=degrees(Slider(90, range=0..1000)), Plane=dispatch.ListA)  # -> Geometry, Transform
merge_7 = Merge(Data1=fillet_2, Data2=item_10.Item3, Data3=item_10.Item)  # -> flatten(Result)
merge_8 = Merge(Data1=fillet, Data2=item_9.Item)  # -> flatten(Result)
weave = Weave(Pattern=equals.Equality, Stream0=rotate_2.Geometry, Stream1=dispatch.ListB, NullGaps=False)
join_3 = JoinCurves(Curves=merge_7, Preserve=False)
join_4 = JoinCurves(Curves=merge_8, Preserve=False)
merge_9 = Merge(Data1=join_3, Data2=join_4, Data3=rectangle.Rectangle)  # -> flatten(Result)
deplane = DeconstructPlane(Plane=weave)  # -> Origin, XAxis, YAxis, ZAxis
end_7 = EndPoints(Curve=move_3.Geometry)  # -> Start, End
runion = RegionUnion(Curves=merge_9)
rdiff = RegionDifference(CurvesA=runion, CurvesB=offcrv)
runion_2 = RegionUnion(Curves=flatten([rdiff, offcrv_2]))
unit_2 = UnitVector(Vector=deplane.XAxis)
item_11 = ListItem(List=end_7.Start, Index=0, Wrap=True)  # -> Item, Item1
amp_2 = Amplitude(Vector=unit_2, Amplitude=Slider(55, range=0..100))
item_12 = ListItem(List=end_7.End, Index=0, Wrap=True)  # -> Item, Item1
explode_7 = Explode(Curve=offcrv_2, Recursive=True)  # -> Segments, Vertices
boundary = BoundarySurfaces(Edges=runion_2)
neg_5 = Negative(Value=amp_2)

# ---- group: KUKA TEST / Next Postion
point = Point([Point(1772.32762, 600.1144041, 620.3258303), Point(1772.32762, -1633.302413, 620.3258303)])
list_item = ListItem(List=point, Index=0, Wrap=True)  # -> Item, Item1
line = Line(StartPoint=list_item.Item, EndPoint=list_item.Item1)
divide_curve = DivideCurve(Curve=line, Count=Slider(30, range=0..100), Kinks=False)  # -> Points, Tangents, Parameters
flip_plane = FlipPlane(Plane=divide_curve.Points, FlipX=False, FlipY=False, FlipZ=True)  # -> Flipped, ResultBoolean
list_item_2 = ListItem(List=flip_plane.Flipped, Index=c_script.NextPointIndex, Wrap=True)
robot_inverse_kinematics = RobotInverseKinematics(Robot=kuka_kr_125_2_2, TargetTCPFrame=list_item_2, AxisToggles=[False, False, False], useColorPreview=True)  # -> PoseGeometry, AxisValues

# ----
ln_4 = Line(StartPoint=item_11.Item, EndPoint=item_11.Item1)
ln_5 = Line(StartPoint=item_12.Item, EndPoint=item_12.Item1)
item_13 = ListItem(List=explode_7.Vertices, Index=Slider(1, range=0..10), Wrap=True)
move_9 = Move(Geometry=weave, Motion=neg_5)  # -> Geometry, Transform
xy_2 = XYPlane(Origin=item_13)
rotate_3 = Rotate(Geometry=boundary, Angle=degrees(Slider(270, range=0..1000)), Plane=xy_2)  # -> Geometry, Transform
pframes = PerpFrames(Curve=ln_5, Count=Slider(3, range=0..10), Align=True)  # -> Frames, Parameters
rot3d = Rotate3D(Geometry=move_9.Geometry, Angle=degrees(90), Center=move_9.Geometry, Axis=unit_2)  # -> Geometry, Transform
deplane_2 = DeconstructPlane(Plane=rot3d.Geometry)  # -> Origin, XAxis, YAxis, ZAxis
division_4 = Division(A=Slider(54.5, range=0..100), B=2)
orient = Orient(Geometry=rotate_3.Geometry, Source=xy_2, Target=pframes.Frames)  # -> Geometry, Transform
panel_17 = Panel("""0
3""")
unit_3 = UnitVector(Vector=deplane_2.YAxis)
amp_3 = Amplitude(Vector=unit_3, Amplitude=division_4)
offsrf_2 = OffsetSurface(Surface=orient.Geometry, Distance=expr("x/2", ply_thickness), BothSides=True, CreateSolid=True)  # -> flatten(Offset)
neg_6 = Negative(Value=amp_3)
merge_10 = Merge(Data1=graft(amp_3), Data2=graft(neg_6))  # -> simplify(Result)
cull_i_7 = CullIndex(List=offsrf_2, Indices=panel_17, Wrap=True)
xz = XZPlane(Origin=curvepoint_2)
move_10 = Move(Geometry=simplify(graft(rot3d.Geometry)), Motion=merge_10)  # -> Geometry, Transform
mirror = Mirror(Geometry=cull_i_7, Plane=xz)  # -> Geometry, Transform
preview = CustomPreview(Geometry=cull_i_7, Material=ColourSwatch(SwatchColor=RGB(255, 255, 255)))  # disabled
cir = Circle(Plane=move_10.Geometry, Radius=Slider(20.5, range=0..100))
get_frame = GetFrame(Frame=list_item_2)  # -> XYZLocation, ABCOrientation
boundary_2 = BoundarySurfaces(Edges=cir)
offsrf_3 = OffsetSurface(Surface=boundary_2, Distance=Slider(100, range=0..1000), BothSides=True, CreateSolid=True)
trim = TrimTree(Tree=offsrf_3, Depth=1)
brep_2 = Brep(trim)
area = Area(Geometry=brep_2)  # -> Area, Centroid
average = Average(Input=area.Centroid)  # -> flatten(ArithmeticMean)
group = Group(Objects=brep_2)  # -> flatten(Group)
deconstruct = Deconstruct(Point=average)  # -> XComponent, YComponent, ZComponent
list_length = ListLength(List=average)
series_2 = Series(Start=0, Step=1, Count=list_length)
sort_list = SortList(Keys=deconstruct.YComponent, ValuesValuesA=series_2)  # -> Keys, ValuesValuesA
list_item_3 = ListItem(List=group, Index=sort_list.ValuesValuesA, Wrap=True)
ungroup = Ungroup(Group=list_item_3)
trim_solid = TrimSolid(Shape=brep, Cutters=ungroup)
sdiff = SolidDifference(BrepsA=simplify(brep), BrepsB=ungroup)  # -> simplify(Result)
geo = Geometry(simplify(trim_solid))
brep_edges = BrepEdges(Brep=geo)  # -> Naked, Interior, NonManifold
list_item_4 = ListItem(List=brep_edges.Naked, Index=Slider(0, range=0..10), Wrap=True)  # -> Item, Item1, Item2, Item3
planar = Planar(Curve=list_item_4.Item2)  # -> Planar, Plane, Deviation
planar_2 = Planar(Curve=list_item_4.Item)  # -> Planar, Plane, Deviation
loft_2 = Loft(
    Curves=[list_item_4.Item2, list_item_4.Item3],
    Options={Adjust=False, Closed=False, LoftEnds=0, LoftSimp=0, LoftType=0, Rebuild=10, Refit=0.01})  # -> simplify(Loft)
loft_3 = Loft(
    Curves=[list_item_4.Item, list_item_4.Item1],
    Options={Adjust=False, Closed=False, LoftEnds=0, LoftSimp=0, LoftType=0, Rebuild=10, Refit=0.01})  # -> simplify(Loft)
brep_join = BrepJoin(Breps=[loft_3, loft_2, geo])  # -> Breps, simplify(Closed)
curve = Curve(simplify(brep_edges.Interior))
average_plane = AveragePlane(Planes=[planar.Plane, planar_2.Plane])
list_item_5 = ListItem(List=curve, Index=Slider(3, range=0..10), Wrap=True)
point_on_curve = PointOnCurve(list_item_5, parameter=0.5)
list_item_6 = ListItem(List=flatten(point_on_curve), Index=Slider(1, range=0..10), Wrap=True)
deconstruct_2 = Deconstruct(Point=get_frame.XYZLocation)  # -> XComponent, YComponent, ZComponent
deconstruct_vector = DeconstructVector(Vector=get_frame.ABCOrientation)  # -> XComponent, YComponent, ZComponent

geo_2 = Geometry(brep_join.Breps)
plane = Plane(average_plane)
geo_3 = Geometry([mirror.Geometry, cull_i_7])

sdiff_2 = SolidDifference(BrepsA=geo_2, BrepsB=simplify(flatten(geo_3)))  # disabled
rot3d_2 = Rotate3D(Geometry=flatten(sdiff_2), Angle=expr("-x", merge_3), Center=pt_4, Axis=X_5)  # -> Geometry, Transform
move_11 = Move(Geometry=rot3d_2.Geometry, Motion=X_6)  # -> Geometry, Transform
project_2 = Project(Geometry=move_11.Geometry, Plane=PlaneXY(0, 0, 0))  # -> Geometry, Transform
ghpython_script = GhPythonScript(
    x=deconstruct_2.XComponent,
    y=deconstruct_2.YComponent,
    z=deconstruct_2.ZComponent,
    A=deconstruct_vector.XComponent,
    B=deconstruct_vector.YComponent,
    C=deconstruct_vector.ZComponent)  # -> out, a
# ---------- ghpython_script: Python ----------
f = " "
f = "{E6POS: X " , x , ", Y " , y , ", Z " , z , ", A " , A , ", B " , B , ", C " , C , ", S 18, T 10, E1 3.708465E-04, E2 0.0, E3 0.0, E4 0.0, E5 0.0, E6 0.0}"
a = f
# ---------- end ghpython_script ----------
text_join = TextJoin(Text=ghpython_script.a)

# ---- group: KUKA TEST
custom_write_2 = KRCWrite(Socket=client, Write="NextReceived", Input=c_script.ReceivedNextPoint, Run=c_script.Go, RefreshRate=20)
panel_18 = Panel(custom_write_2)

# ---- group: KUKA TEST / Move Kuka To Point
write_position = WritePosition(Write="KukaToPoint", AxisValues=robot_inverse_kinematics.AxisValues, RefreshRate=20)
panel_19 = Panel(write_position)

# ----
custom_write_3 = KRCWrite(Socket=client, Write="KukaToPoint", Input=text_join, Run=c_script.Go, RefreshRate=20)
panel_20 = Panel(custom_write_3)

panel_21 = Panel(text_join)
preview_2 = CustomPreview(
    Geometry=flatten([geo_2, geo_3]),
    Material={diffuse=RGB(221, 160, 221), emission=RGB(66, 48, 66), shine=0.5, specular=RGB(255, 255, 255), transparency=0})
wires_2 = BrepWireframe(Brep=geo_2, Density=-1)

# ---- group: Move Frame Around X Axis
number_slider_7 = Slider(-42, range=-90..90)
yz_plane = YZPlane(Origin=Point(0, 0, 0))
radians = Radians(Degrees=number_slider_7)
rotate_3d = Rotate3D(Geometry=plane, Angle=radians, Center=plane, Axis=yz_plane)  # -> Geometry, Transform

# ---- group: IMU Data
# 2. ROS
toggle_2 = BooleanToggle(False)
timer = Timer(TimerInterval=500, Target=python)  # disabled
python = GhPythonScript(subscribe=toggle_2, topic_args="/IMU_Publisher,sensor_msgs/Imu")  # -> out, msg_str; inputs subscribe: Boolean, topic_args: list
# ---------- python: Python ----------
__author__ = "Ondrej Kyjanek"
__version__ = "2019.12.27"

import json
import roslibpy
from collections import deque
from Grasshopper.Kernel import GH_RuntimeMessageLevel

QUEUE_SIZE = 1
IS_STACK = False

def callback(message):
    queue.append(message)

topic_args = [[y.strip() for y in x.split(',')] for x in  topic_args]

if 'topic' not in globals(): 
    topic = []
    msg_json = None
    queue = None
    is_subscribed = False

if subscribe==None or subscribe==False:
    for t in topic:
        t.unsubscribe()
    ghenv.Component.Message = "Unsubscribed"
    is_subscribed = False
elif subscribe and instance!=None and is_subscribed == False:
    global queue
    queue = deque(maxlen=QUEUE_SIZE)
    msg_json = None
    topic = []
    
    for ta in topic_args:
        _t = roslibpy.Topic(instance, ta[0], ta[1])
        _t.subscribe(callback)
        topic.append(_t)
    ghenv.Component.Message = "Subscribed"
    is_subscribed = True
elif instance==None:
    ghenv.Component.Message = ""
    ghenv.Component.AddRuntimeMessage(
        GH_RuntimeMessageLevel.Warning,
        "Client is not connected")

try:
    print(queue)
    for i,t in enumerate(topic):
        print('Topic {} is subscribed: {}'.format(
            t.name,
            t.is_subscribed))
    if IS_STACK:
        msg_json = queue.popright()
    else:
        msg_json = queue.popleft()
except Exception as e:
    print(e)
msg_str = json.dumps(msg_json)
# ---------- end python ----------
python_2 = GhPythonScript(msg_str=python.msg_str)  # -> key, value
# ---------- python_2: Python ----------
__author__ = "Ondrej Kyjanek"
__version__ = "2019.12.28"

import json
from Grasshopper.Kernel import GH_Param
from Grasshopper.Kernel.Parameters import Param_GenericObject
from System import Object, Array
from Grasshopper import DataTree
from Grasshopper.Kernel.Data import GH_Path

value = DataTree[Object]()
key = DataTree[str]()

def expand_msg(_msg,_path,_key=''):
    if type(_msg) == dict:
        for i,kv in enumerate(_msg.items()):
            path_copy = _path[:]
            path_copy.append(i)
            expand_msg(kv[1],path_copy,kv[0])
    elif type(_msg) == list:
        for x in _msg:
            _path[len(_path)-1]+=1
            expand_msg(x,_path,_key)
    else:
        
        value.Add(_msg,GH_Path(Array[int](_path)))
        key.Add(_key,GH_Path(Array[int](_path)))

msg = json.loads(msg_str)
expand_msg(msg,[0],'')
# ---------- end python_2 ----------
panel_22 = Panel(python_2.value)
panel_23 = Panel(python.out)

timer_2 = Timer(TimerInterval=500, Target=python_3)  # disabled
python_3 = GhPythonScript(subscribe=Toggle(False), topic_args="/TOF_Publisher,sensor_msgs/Range")  # -> out, msg_str; inputs subscribe: Boolean, topic_args: list; same code as python
python_4 = GhPythonScript(msg_str=python_3.msg_str)  # -> key, value; same code as python_2
panel_24 = Panel(python_4.value)
panel_25 = Panel(python_3.out)

# ----
python_5 = GhPythonScript(list=Button(), kill=Button())  # -> out; inputs kill: Boolean
# ---------- python_5: Python ----------
__author__ = "Ondrej Kyjanek"
__version__ = "2019.12.26"

import rhinoscriptsyntax as rs
import threading

if list:
    thread_names = []
    for t in threading.enumerate():
        thread_names.append(t.name)

if kill:
    thread_names = []
    for t in threading.enumerate():
        thread_names.append(t.name)
        if t.name.split('-')[0] == 'RoslibThread':
            t.stop()
            t.join(3)

if 'thread_names' in globals():
    for tn in thread_names:
        print(tn)
# ---------- end python_5 ----------
panel_26 = Panel(python_5)
# deque([{'field_of_view': 0.0, 'range': 8190.0, 'max_range': 0.0, 'min_range': 0.0, 'header': {'seq': 516, 'frame_id': 'Simon', 'stamp': {'nsecs': 14487981, 'secs': 1578819548}}, 'radiation_type': 0}], maxlen=1)
# Topic /TOF_Publisher is subscribed: True
list_item_7 = ListItem(List=flatten(python_4.value), Index=0, Wrap=True)  # -> Item, Item1
# deque([{'orientation': {'z': -128.0, 'w': 0.0, 'y': -48.0, 'x': -67.0}, 'angular_velocity': {'z': 0.0, 'y': 0.0, 'x': 0.0}, 'linear_acceleration_covariance': [0.0, 0.0, 0.0, 0.0, 0.0, 0.0, 0.0, 0.0, 0.0], 'orientation_covariance': [0.0, 0.0, 0.0, 0.0, 0.0, 0.0, 0.0, 0.0, 0.0], 'linear_acceleration': {'z': 16268.0, 'y': 12.0, 'x': -828.0}, 'angular_velocity_covariance': [0.0, 0.0, 0.0, 0.0, 0.0, 0.0, 0.0, 0.0, 0.0], 'header': {'seq': 807, 'frame_id': 'Simon', 'stamp': {'nsecs': 915903091, 'secs': 1578814565}}}], maxlen=1)
# Topic /IMU_Publisher is subscribed: True
panel_27 = Panel(python_2.key)
# {'success': True, 'message': 'The motors started'}
distance = Panel(list_item_7.Item1)

# ---- group: Piece + 1
number_slider_8 = Slider(0, range=0..10)

# ----
brep_3 = Brep(geo_2)
list_item_8 = ListItem(List=flatten(brep_3), Index=0, Wrap=True)  # -> Item, Item1, Item2, Item3, Item4, Item5, Item6, Item7
addition = Addition(A=number_slider_8, B="1")

# ---- group: Pick Up Routine
point_2 = Point(<point referenced from the Rhino model>)
unit_x = UnitX(Factor=Slider(189, range=0..1000))
unit_y = UnitY(Factor=expr("-X", Slider(463, range=0..1000)))
unit_z = UnitZ(Factor=Slider(383, range=0..1000))
move_12 = Move(Geometry=point_2, Motion=unit_z)  # -> Geometry, Transform
move_13 = Move(Geometry=move_12.Geometry, Motion=unit_z)  # -> Geometry, Transform
move_14 = Move(Geometry=move_13.Geometry, Motion=unit_y)  # -> Geometry, Transform
merge_11 = Merge(Data1=point_2, Data2=move_12.Geometry, Data3=move_13.Geometry, Data4=move_14.Geometry)
xy_3 = XYPlane(Origin=merge_11)
pflip = FlipPlane(Plane=xy_3, ReverseX=False, ReverseY=False, SwapAxes=True)
reverse_list = ReverseList(List=pflip)
merge_12 = Merge(Data1=reverse_list, Data2=pflip)
list_item_9 = ListItem(List=merge_12, Index=0, Wrap=True)

# ----
point_3 = Point(point_on_curve)
move_to_point = MoveToPoint(Geometry=rotate_3d.Geometry, PointA=rotate_3d.Geometry, PointB=point_3)  # -> Moved, Vector, Transform

# ---- group: Current Robot Frame
list_item_10 = ListItem(List=flatten(move_to_point.Moved), Index=number_slider_8, Wrap=True)

# ----
move_to_point_2 = MoveToPoint(Geometry=list_item_8.Item1, PointA=move_to_point.Moved, PointB=move_to_point.Moved)  # -> Moved, Vector, Transform
number_slider_9 = Slider(0, range=0..1000)

# ---- group: How the frames should be
plane_2 = Plane(plane)

# ----
list_item_11 = ListItem(List=flatten(plane_2), Index=addition, Wrap=True)
c_script_2 = CSharpScript()  # -> out, StiffyDrive, NextReceived, KukaFast, GoNextReceived, GoKukaFast, GoNextPoint
# ---------- c_script_2: C# ----------
    //    #0.
    //    #Kuka grabs piece
    //    #Stiffy drive
StiffyDrive = true;
Counter = 0;

public void PickUpRoutine(){

  Rhino.Geometry.Plane p = Kuka_PickupFrames[Kuka_MoveCounter];
  Counter += 0;
      
  };



    //#1.
    //#Stop stiffy drive when distance >300
    //#Kuka wait until stiffy stopped.

    //#2.
    //#Set Kuka to low speed
    //#Kuka positions piece in plane of stiffy.

    //    #3.
    //#When tolerance < X Kuka starts moving the piece in place.

    //#4.
    //#Stiffy (or user) says when the plate is correctly placed.
# ---------- end c_script_2 ----------
surface = Surface(move_to_point.Moved)
radians_2 = Radians(Degrees=number_slider_7)
panel_28 = Panel("0")
deconstruct_plane = DeconstructPlane(Plane=surface)  # -> Origin, XAxis, YAxis, ZAxis
list_item_12 = ListItem(Index=Slider(1, range=0..10), Wrap=True)
unit_z_2 = UnitZ(Factor=number_slider_9)  # -> expr("-X", UnitVector)
yz_plane_2 = YZPlane(Origin=Point(0, 0, 0))
plane_3 = Plane(list_item_11)
unit_z_3 = UnitZ(Factor=number_slider_9)  # -> expr("-X", UnitVector)
unit_z_4 = UnitZ(Factor=1)
list_item_13 = ListItem(List=flatten(plane_2), Index=number_slider_8, Wrap=True)
project_along = ProjectAlong(Geometry=point_3, Plane=PlaneXY(0, 0, 0), Direction=deconstruct_plane.ZAxis)  # -> Geometry, Transform
move_15 = Move(Geometry=list_item_10, Motion=unit_z_2)  # -> Geometry, Transform
angle_3 = Angle(VectorA=unit_z_4, VectorB=deconstruct_plane.ZAxis)  # -> Angle, Reflex
move_16 = Move(Geometry=list_item_11, Motion=unit_z_3)  # -> Geometry, Transform
rotate_3d_2 = Rotate3D(Geometry=move_16.Geometry, Angle=radians_2, Center=move_15.Geometry, Axis=yz_plane_2)  # -> Geometry, Transform
line_2 = Line(StartPoint=point_3, EndPoint=project_along.Geometry)
kuka_kr_125_2_3 = PredefinedKUKAKR1252(RobRootFrame=PlaneXY(0, 0, 0))
cosine = Cosine(Value=angle_3.Angle)
length = Length(Curve=line_2)
robot_fk_2 = RobotForwardKinematics(Robot=kuka_kr_125_2_3, AxisValues=panel_7, useColorPreview=True)  # -> PoseGeometry, TCPFrame; disabled

# ---- group: Height
multiplication = Multiplication(A=cosine, B=length)  # -> flatten(Result)
unit_z_5 = UnitZ(Factor=multiplication)
move_17 = Move(Geometry=flatten(point_3), Motion=unit_z_5)  # -> Geometry, Transform

# ----
pln_5 = Plane(robot_fk_2.TCPFrame)  # disabled

# ---- group: Move plane in y direction
number_slider_10 = Slider(0, range=0..1000)
deconstruct_plane_2 = DeconstructPlane(Plane=rotate_3d_2.Geometry)  # -> Origin, XAxis, YAxis, ZAxis
negative = Negative(Value=Slider(-100, range=-100..1000))
multiplication_2 = Multiplication(A=deconstruct_plane_2.XAxis, B=negative)
move_18 = Move(Geometry=rotate_3d_2.Geometry, Motion=multiplication_2)  # -> Geometry, Transform

# ----
robot_inverse_kinematics_2 = RobotInverseKinematics(Robot=kuka_kr_125_2_3, TargetTCPFrame=move_18.Geometry, AxisToggles=[False, False, False], useColorPreview=True)  # -> PoseGeometry, AxisValues
panel_29 = Panel(multiplication)

# ---- group: If distance too big, stop motors
ghpython_script_2 = GhPythonScript(dist=distance)  # -> out, Motors, Go
# ---------- ghpython_script_2: Python ----------
if dist > 50:
    Motors = False
    Go = True
# ---------- end ghpython_script_2 ----------

# ---- group: Start/Stop Motors
python_6 = GhPythonScript(send=Button(), service_args="Start_Motors,start_motors", SetMotorState=Toggle(False))  # -> out, resp_str; inputs send: Boolean, SetMotorState: Boolean
# ---------- python_6: Python ----------
__author__ = "Ondrej Kyjanek"
__version__ = "2019.12.27"

import json
import roslibpy
from collections import deque
from Grasshopper.Kernel import GH_RuntimeMessageLevel

service_args = [y.strip() for y in service_args.split(',')]

if send and instance != None and instance.is_connected:
    ghenv.Component.Message = ""
    error = None
    response = None
    service = roslibpy.Service(instance, service_args[0],service_args[1])
    request = roslibpy.ServiceRequest({"data" : SetMotorState})
    try:
        ghenv.Component.Message = "Response send"
        response = service.call(request,timeout=5)
    except Exception as e:
        error = e

if "error" in globals():
    print(error)
    if response:
        resp_str = response
        ghenv.Component.Message = "Response received"
    else:
        ghenv.Component.Message = ""
# ---------- end python_6 ----------
panel_30 = Panel(python_6.resp_str)

# 1. ROS
panel_31 = Panel("Start_Motors,start_motors")
boolean_toggle = BooleanToggle(False)
button = Button()
python_7 = GhPythonScript(send=ghpython_script_2.Go, service_args=panel_31, SetMotorState=ghpython_script_2.Motors)  # -> out, resp_str; inputs send: Boolean, SetMotorState: Boolean; same code as python_6
panel_32 = Panel(python_7.resp_str)

# ==== cluster ColorRobot
L = ClusterInput()
item = ListItem(List=L, Index=0, Wrap=True)  # -> Item, Item1, Item2, Item3, Item4, Item5, Item6, Item7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
kd = ClusterInput()
ks = ClusterInput()
ke = ClusterInput()
kd_2 = ClusterInput()
ks_2 = ClusterInput()
ke_2 = ClusterInput()
material = CreateMaterial(Diffuse=kd, Specular=ks, Emission=ke, Transparency=0, Shine=Slider(30, range=0..100))
material_2 = CreateMaterial(Diffuse=kd_2, Specular=ks_2, Emission=ke_2, Transparency=0, Shine=0)
preview = CustomPreview(
    Geometry=[item.Item15, item.Item14, item.Item13, item.Item12, item.Item11, item.Item7, item.Item5, item.Item4, item.Item1, item.Item10, item.Item18, item.Item19, item.Item20],
    Material=material)
preview_2 = CustomPreview(
    Geometry=[item.Item, item.Item2, item.Item3, item.Item6, item.Item8, item.Item9, item.Item16, item.Item17],
    Material=material_2)
