# Grasshopper definition SampleFile_KukaVarProxy_With_VirtualRobot.gh (Grasshopper 1.0.7)
# plug-ins: Simulacrum, Virtual Robot

client = TCPClient(ServerIP="141.58.154.149", ServerPort="7000", ConnectionTrigger=Toggle(False))

# ---- group: Write Values
panel = Panel("""0.0
-90
100
0.0
0.0
0.0""")
custom_write = KRCWrite(Socket=client, Write="SimonBool", Input="False", Run=Button(), RefreshRate=20)
write_position = WritePosition(Socket=client, Write="MyPosSimon", AxisValues=panel, Run=Button())
panel_2 = Panel(custom_write)
panel_3 = Panel(write_position)

# ---- group: Read Values
read_position = ReadActPos(Socket=client, Run=Toggle(False), RefreshRate="300")  # -> AxisValues, TCPPlane, XYZ, ABC, E6POS, E6AXIS
custom_read = KRCRead(Socket=client, VarRead="SimonBool", ReadTrigger=Toggle(True), RefreshRate=20)
read_base = ReadBase(Socket=client, Run=Button())  # -> BASE, BASEPlane, TOOL, TOOLPlane
panel_4 = Panel(custom_read)
panel_5 = Panel(read_position.AxisValues)
pln = Plane(read_base.TOOLPlane)
pln_2 = Plane(read_base.BASEPlane)
panel_6 = Panel(read_base.TOOL)
panel_7 = Panel(read_base.BASE)
pln_3 = Plane(read_position.TCPPlane)

# ----
monitor = NetstatMonitor(Socket=client)  # disabled

# ---- group: Check Connection
panel_8 = Panel(monitor)

# ---- group: Kuka Datatype Converter
converter = Converter(E6POS=read_position.E6POS, E6AXIS=read_position.E6AXIS)  # -> E6POSNames, E6POSValues, E6AXISNames, E6AXISValues, FRAMENames, FRAMEValues
panel_9 = Panel(converter.E6POSNames)
panel_10 = Panel(converter.E6POSValues)

# ----
kuka_kr_125_2 = PredefinedKUKAKR1252(RobRootFrame=PlaneXY(0, 0, 0))

# ---- group: Robot Sim
robot_fk = RobotForwardKinematics(Robot=kuka_kr_125_2, AxisValues=panel_5, useColorPreview=True)  # -> PoseGeometry, TCPFrame
pln_4 = Plane(robot_fk.TCPFrame)
